# Grasshopper definition 141008_MeshAnalysis_Example.gh (Grasshopper 0.9.76)
# plug-ins: Python Interpreter

# ---- group: Copy and Translate Mesh to Analyse
mesh = Mesh(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)
number_slider = Slider(27.86, range=0..100)
series = Series(Start=number_slider, Step=number_slider, Count=Slider(3, range=1..5))
X = UnitX(Factor=series)
move = Move(Geometry=mesh, Motion=X)  # -> Geometry, Transform
item = ListItem(List=move.Geometry, Index=0, Wrap=True)  # -> Item, Item1, Item2

# ---- group: Mesh Curvature Analysis
curvaturemode = ValueList({"Least": "min", "Most": "max", "Average": "mean"}, selected="Average")
negativeoff = BooleanToggle(True)
mesh_2 = Mesh(item.Item)
meshcurvature = MeshCurvatureAnalysis(Toggle=Toggle(True), Mesh=mesh_2, Mode=curvaturemode, Angle=Slider(120, range=0..360), NegativeOff=negativeoff)  # -> CMesh, Curvature, Colors, CurvatureSum, CurvatureBounds, CurvatureSorted; inputs Toggle: Boolean, Mesh: Mesh, NegativeOff: Boolean
# ---------- meshcurvature: Python ----------
"""
Analyse mesh curvature. Curvature is defined as the angle between a vertex normal
and the vector from this vertex to its neighbours. Zero curvature is thus equal 
to 90 degrees. However to evaluate positive and negative curvatures 90 is subtracted
from this value. Meaning that negative curvature will be a negative value and
positive curvature a positive value.
-
Name: MeshCurvature
Updated: 140818
Author: Anders Holden Deleuran (CITA/KADK)
Copyright: Creative Commons - Attribution 4.0 International
GitHub: www.github.com/AndersDeleuran/MeshAnalysis
Contact: adel@kadk.dk

    Args:
        Toggle: Activates the component.
        Mesh: The mesh to analyse.
        Mode: The curvature mode to calculate ("min","max" or "mean").
        Angle: The angle in degrees at which the mesh is unwelded.
        NegativeOff: If True negative curvature is treated as if positive.
    Returns:
        Mesh: A mesh colored by its curvature values.
        Curvature: The curvature values for each vertex.
        Colors: The curvature color for each vertex.
        CurvatureSum: The total curvature.
        CurvatureBounds: The minimum and maximum curvature.
        CurvatureSorted: Sorted curvature values (for graph mapping).
        MeshArea: The area of the mesh.
"""

import Rhino as rc
import math


# Set component name/nick
ghenv.Component.Name = "MeshCurvatureAnalysis"
ghenv.Component.NickName = "MeshCurvature"

def meshCurvature(mesh,mode,negativeOff):
    
    """ Calculate the curvature of a mesh using vertex normal angle 
    from each vertex to its neighbours """
    
    # Calculate mesh normals
    mesh.FaceNormals.ComputeFaceNormals()
    mesh.Normals.ComputeNormals()
    
    # Output list
    curvature = []
    
    # Iterate mesh vertices
    for i in range(mesh.Vertices.Count):
        
        # Get vertex, vertex normal and vertex neighbour IDs
        centerVertex = mesh.Vertices.Item[i]
        centerNormal = mesh.Normals.Item[i]
        neighbourIDs = mesh.Vertices.GetConnectedVertices(i)
        
        # Iterate neighbouring vertices
        angles = []
        for j in neighbourIDs:
            
            # Make vector from vertex to neighbour and check its length
            neighbourVertex = mesh.Vertices.Item[j]
            neighbourDirection = neighbourVertex - centerVertex
            if neighbourDirection.Length > 0:
                
                # Calculate angle between normal and new vector
                a = rc.Geometry.Vector3d.VectorAngle(centerNormal,neighbourDirection)
                
                # Subtract it from 90 and optionally get absolute value (no negative curvature)
                a = math.degrees(a) - 90
                if negativeOff:
                    a = abs(a)
                    
                # Add to list
                angles.append(a)
                
        # Calculate curvature depending on mode
        if mode == "min":
            curvature.append(min(angles))
            
        elif mode == "max":
            curvature.append(max(angles))
            
        elif mode == "mean":
            curvature.append(sum(angles)/len(angles))
            
    return curvature

def remapValues(values,targetMin,targetMax):
    
    """ Remap numbers into a new numeric domain """
    
    # Check that different values exist
    if len(set(values)) > 1:
        
        remappedValues = []
        
        # Get sourceDomain min and max
        srcMin = min(values)
        srcMax = max(values)
        
        # Iterate the values and remap them
        for v in values:
            rv = ((v-srcMin)/(srcMax-srcMin))*(targetMax-targetMin)+targetMin
            remappedValues.append(rv)
            
        return remappedValues
        
    # Else return targetMax for each value
    else:
        return [targetMin]*len(values)

def mapValueListAsColors(values):
    
    """ Make a list of HSL color where the values are mapped onto a
    0.0 - 0.7 hue domain. Meaning that low values will be red, medium
    values green and large values blue """
    
    colors = []
    remappedValues = remapValues(values,0.0,0.7)
    for v in remappedValues:
        c = rc.Display.ColorHSL(v,1.0,0.5).ToArgbColor()
        colors.append(c)
        
    return colors

def colorMesh(mesh,colors):
    """ Color mesh vertices by list of colors """
    for i,c in enumerate(colors):
        mesh.VertexColors.SetColor(i,c)

# Calls and GH output
if Toggle:
    if Mesh:
        
        # Unweld the mesh at sharp angles
        Mesh.Unweld(math.radians(Angle),True)
        
        # Calculate curvature, sorted values, sum etc,
        Curvature = meshCurvature(Mesh,Mode,NegativeOff)
        CurvatureSorted = sorted(Curvature)
        CurvatureSum = round(sum(Curvature),2)
        CurvatureBounds = (round(min(Curvature),2)),(round(max(Curvature),2))
        
        # Calculate colors and color mesh
        Colors = mapValueListAsColors(Curvature)
        CMesh = Mesh
        colorMesh(CMesh,Colors)
# ---------- end meshcurvature ----------
panel = Panel(meshcurvature.CurvatureSum)
panel_2 = Panel(meshcurvature.CurvatureBounds)
graph = QuickGraph(meshcurvature.CurvatureSorted)

# ---- group: Mesh Drainage Path Analysis
mesh_3 = Mesh(item.Item1)
meshdrainage = MeshDrainage(
    Toggle=Toggle(True),
    Mesh=mesh_3,
    ParticleCount=Slider(500, range=1..1000),
    MaxSteps=Slider(100, range=1..100),
    Tolerance=Slider(0.5, range=0..1),
    RandomSeed=Slider(35, range=0..100))  # -> DrainCurves, EndPoints; inputs Toggle: Boolean, Mesh: Mesh, ParticleCount: Int32, MaxSteps: Int32, RandomSeed: Int32
# ---------- meshdrainage: Python ----------
"""
Simulates drainage in order to analyse a mesh for local pooling of rain water and snow.
-
Name: MeshDrainageAnalysis
Updated: 140621
Author: Anders Holden Deleuran (CITA/KADK)
Copyright: Creative Commons - Attribution 4.0 International
GitHub: www.github.com/AndersDeleuran/MeshAnalysis
Contact: adel@kadk.dk

    Args:
        Toggle: Activates the component.
        Mesh: The mesh to analyse.
        ParticleCount: The amount of particles to simulate (randomly picked from the mesh vertices).
        MaxSteps: The amount steps to iteratively move the particles.
        Tolerance: The precision with which the particles are moved.
        RandomSeed: The random seed with which the particles are picked.
        
    Returns:
        DrainCurves: Curves constructed through the drain positions of each particle.
        EndPoints: The final position of the particles.
"""

import Rhino as rc
import random
import System.Threading.Tasks as tasks

# Set component name/nick
ghenv.Component.Name = "MeshDrainage"
ghenv.Component.NickName = "MeshDrainage"

def makeDrainMeshPaths(mesh,startPoints,maxSteps,tolerance):
    
    """ Estimates the trail of a drainage path on a mesh. Based on Benjamin 
    Golders concept and Remy's VB code found here:
    http://www.grasshopper3d.com/forum/topics/drainage-direction-script """
    
    # Return list
    drainPaths = []
    
    # Task function
    def drainPath(pt):
        
        # Particle list and current particle plane
        particles = []
        paPl = rc.Geometry.Plane(pt,rc.Geometry.Vector3d.ZAxis)
        
        for j in range(maxSteps):
            
            # Get the point on the mesh closest to the particle
            meshPt = mesh.ClosestMeshPoint(paPl.Origin,0.0)
            paPl = rc.Geometry.Plane(meshPt.Point,mesh.NormalAt(meshPt))
            
            # Check that first step has been taken and that current step is down slope
            if j and paPl.Origin.Z > particles[-1].Z:
                break
            else:
                # Add particle to list
                particles.append(paPl.Origin)
                
                # Move particle down slope
                an = rc.Geometry.Vector3d.VectorAngle(paPl.XAxis,-rc.Geometry.Vector3d.ZAxis,paPl)
                paPl.Rotate(an,paPl.ZAxis)
                paPl.Translate(paPl.XAxis*tolerance)
                
        # Make drain curve
        if len(particles) > 1:
            
            crv = rc.Geometry.Curve.CreateControlPointCurve(particles)
            drainPaths.append(crv)
            
    # Call task function
    tasks.Parallel.ForEach(startPoints,drainPath)
    
    return drainPaths

if Toggle and Mesh:
    
    # Get mesh vertices
    Vertices = Mesh.Vertices.ToPoint3dArray()
    
    # Pick random vertices
    if ParticleCount > len(Vertices):
        ParticleCount = len(Vertices)
    random.seed(RandomSeed)
    Vertices = random.sample(Vertices,ParticleCount)
    
    # Make drain curves
    DrainCurves = makeDrainMeshPaths(Mesh,Vertices,MaxSteps,Tolerance)
    EndPoints = [crv.PointAtEnd for crv in DrainCurves]
# ---------- end meshdrainage ----------

# ---- group: Grassfire Transform Analysis
mesh_4 = Mesh(item.Item2)
mb = MeshBurner(Mesh=mesh_4)  # -> BurnFronts; inputs Mesh: Mesh
# ---------- mb: Python ----------
""" 
Iteratively burns the perimeter of a mesh. Similar to the Grassfire transform 
used in image processing for extracting the medial axis on a raster. Outputs 
each burn front as an individual mesh. Note: Has not been optimized for
performance.
-
Name: MeshBurner
Updated: 141008
Author: Anders Holden Deleuran (CITA/KADK)
Copyright: Creative Commons - Attribution 4.0 International
GitHub: www.github.com/AndersDeleuran/MeshAnalysis
Contact: adel@kadk.dk

    Args:
        Mesh: The mesh to analyse.
    Returns:
        BurnFronts: List of grassfire burn fronts as meshes.
"""

import Rhino as rc

# Set component name/nick
ghenv.Component.Name = "MeshBurner"
ghenv.Component.NickName = "MB"

def getNakedFaceIDs(mesh):
    
    """ Return the face indices of any face with a naked vertex """
    
    nakedFaces = []
    
    # Get naked vertices
    nPts = list( mesh.GetNakedEdgePointStatus())
    nIDs = [i for i,v in enumerate(nPts) if v == True]
    
    for i in range(mesh.Faces.Count):
        
        # Get face vertices
        f = mesh.Faces.Item[i]
        if f.IsTriangle:
            vts = (f.A,f.B,f.C)
        else:
            vts = (f.A,f.B,f.C,f.D)
        
        # Check if they are naked
        naked = False
        for vt in vts:
            if vt in nIDs:
                naked = True
                
        if naked:
            nakedFaces.append(i)
            
    return nakedFaces

def meshBurner(mesh):
    
    """ Dicretize a mesh using a grassfire algorithm """
    
    burnFronts = []
    while mesh.Faces.Count:
        
        # Make burn front mesh and add vertices to it
        bm = rc.Geometry.Mesh()
        bm.Vertices.AddVertices(mesh.Vertices.ToPoint3fArray())
        
        # Add the burn perimeter to the mesh
        nfIDs = getNakedFaceIDs(mesh)
        nf = [mesh.Faces.Item[i] for i in nfIDs]
        bm.Faces.AddFaces(nf)
        
        # Compact and append to output list
        bm.Compact()
        bm.Normals.ComputeNormals()
        burnFronts.append(bm)
        
        # Delete the burned faces
        mesh.Faces.DeleteFaces(nfIDs)
        
    return burnFronts

if Mesh:
    BurnFronts = meshBurner(Mesh)
# ---------- end mb ----------
R = R(mesh=mb)

# ==== cluster R: Render
mesh = ClusterInput()
mesh_2 = Mesh(mesh)
lng = ListLength(List=mesh_2)
range = Range(Domain=Domain(0, 1), Steps=lng)
gradient = Gradient(
    LowerLimit=0,
    UpperLimit=1,
    Parameter=range,
    stops=[0: RGB(234, 38, 0), 0.25: RGB(234, 126, 0), 0.5: RGB(254, 244, 84), 0.75: RGB(173, 203, 249), 1: RGB(75, 107, 169)])
mcol = MeshColours(Mesh=graft(mesh_2), Colours=reverse(graft(gradient)))  # -> flatten(Mesh)
