# Grasshopper definition 180419_BoundarySurfaces.gh (Grasshopper 0.9.76)

crv = Curve([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])
crv_2 = Curve([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])

# ---- group: Make Trimmed Surfaces
boundary = BoundarySurfaces(Edges=crv_2)

# ---- group: Color/Render
srf = Surface(boundary)
lng = ListLength(List=srf)
range = Range(Domain=Domain(0, 0.7), Steps=lng)
hsl = ColourHSL(Alpha=1, Hue=range, Saturation=1, Luminance=0.5)
preview = CustomPreview(Geometry=srf, Shader=hsl)

# ---- group: Get the Edges/Polylines
edges = BrepEdges(Brep=boundary)  # -> Naked, Interior, NonManifold
